# Grasshopper definition SPGLoader.gh (Grasshopper 1.0.7)

# Select the EoE.json here
path = FilePath("/Users/subtool/projects/engines of eternity/SPG/EoE-code.json")
python = GhPythonScript(FilePath=path)  # -> out, bagAmount, sampleAmount, dataPointAmount, original, modified
# ---------- python: Python ----------
import json

if FilePath:
    
    # JSON file to read
    file = open(FilePath)
    
    # Load the data
    data = json.load(file)
    
    bagAmount = data["bagAmount"]
    sampleAmount = data["sampleAmount"]
    dataPointAmount = data["amountOfDataPoints"]
    original=data["allOriginal"]
    modified=data["allModified"]
    
    # Do something with the data
    print data
else:
     print "path not found"
# ---------- end python ----------
panel = Panel(python.original)
panel_2 = Panel(python.modified)
panel_3 = Panel(python.bagAmount)
panel_4 = Panel(python.dataPointAmount)
panel_5 = Panel(python.out)
panel_6 = Panel(python.sampleAmount)
